test file "BSL"
  coverage: Decision, MCDC, Condition

suite "New Test Suite 1"

  case "New Test Case 1" [baseline]
    model FBFunctions, harness FBFunctions_Harness_BSL (for FBFunctions/BSL_DUPLEX)
    pre-load callback:
      TestCase = 1;

  case "New Test Case 2" [baseline]
    model FBFunctions, harness FBFunctions_Harness_BSL (for FBFunctions/BSL_DUPLEX)
    pre-load callback:
      TestCase = 2;

  case "New Test Case 3" [baseline]
    model FBFunctions, harness FBFunctions_Harness_BSL (for FBFunctions/BSL_DUPLEX)
    pre-load callback:
      TestCase = 3;

  case "New Test Case 4" [baseline]
    model FBFunctions, harness FBFunctions_Harness_BSL (for FBFunctions/BSL_DUPLEX)
    pre-load callback:
      TestCase = 4;

  case "New Test Case 5" [baseline]
    model FBFunctions, harness FBFunctions_Harness_BSL (for FBFunctions/BSL_DUPLEX)
    pre-load callback:
      TestCase = 5;

  case "New Test Case 6" [baseline]
    model FBFunctions, harness FBFunctions_Harness_BSL (for FBFunctions/BSL_DUPLEX)
    pre-load callback:
      TestCase = 6