test file "SUB"
  coverage: Decision, MCDC, Condition

suite "New Test Suite 1"

  case "New Test Case 1" [baseline]
    model FBFunctions, harness FBFunctions_Harness4 (for FBFunctions/SUB_DUPLEX)
    parameter set "Parameter Set 1" (off): TestInps = 1  % base workspace
    parameter set "Parameter Set 2" (off): TestInps = 2  % base workspace
    parameter set "Parameter Set 3" (off): TestInps = 3  % base workspace
    parameter set "Parameter Set 4" (off): TestInps = 4  % base workspace
    parameter set "Parameter Set 5" (off): TestInps = 5  % base workspace
    parameter set "Parameter Set 6" (off): TestInps = 6  % base workspace
    parameter set "Parameter Set 7" (off): TestInps = 7  % base workspace
    parameter set "Parameter Set 8" (off): TestInps = 8  % base workspace
    parameter set "Parameter Set 9" (off): TestInps = 9  % base workspace
    parameter set "Parameter Set 10" (off): TestInps = 10  % base workspace
    parameter set "Parameter Set 11" (off): TestInps = 11  % base workspace
    parameter set "Parameter Set 12" (off): TestInps = 12  % base workspace
    parameter set "Parameter Set 13" (off): TestInps = 13  % base workspace
    parameter set "Parameter Set 14": TestInps = 14  % base workspace
    pre-load callback:
      TestCase = 1;
    iterations:
      Iteration1: ParameterSet "Parameter Set 1"
      Iteration2: ParameterSet "Parameter Set 2"
      Iteration3: ParameterSet "Parameter Set 3"
      Iteration4: ParameterSet "Parameter Set 4"
      Iteration5: ParameterSet "Parameter Set 5"
      Iteration6: ParameterSet "Parameter Set 6"
      Iteration7: ParameterSet "Parameter Set 7"
      Iteration8: ParameterSet "Parameter Set 8"
      Iteration9: ParameterSet "Parameter Set 9"
      Iteration10: ParameterSet "Parameter Set 10"
      Iteration11: ParameterSet "Parameter Set 11"
      Iteration12: ParameterSet "Parameter Set 12"
      Iteration13: ParameterSet "Parameter Set 13"
      Iteration14: ParameterSet "Parameter Set 14"

  case "New Test Case 2" [baseline]
    model FBFunctions, harness FBFunctions_Harness4 (for FBFunctions/SUB_DUPLEX)
    pre-load callback:
      TestCase = 2;

  case "New Test Case 3" [baseline]
    model FBFunctions, harness FBFunctions_Harness4 (for FBFunctions/SUB_DUPLEX)
    pre-load callback:
      TestCase = 3

  case "New Test Case 4" [baseline]
    model FBFunctions, harness FBFunctions_Harness4 (for FBFunctions/SUB_DUPLEX)
    pre-load callback:
      TestCase = 4;

  case "New Test Case 5" [baseline]
    model FBFunctions, harness FBFunctions_Harness4 (for FBFunctions/SUB_DUPLEX)
    pre-load callback:
      TestCase = 5;

  case "New Test Case 6" [baseline]
    model FBFunctions, harness FBFunctions_Harness4 (for FBFunctions/SUB_DUPLEX)
    pre-load callback:
      TestCase = 6;

  case "New Test Case 7" [baseline]
    model FBFunctions, harness FBFunctions_Harness4 (for FBFunctions/SUB_DUPLEX)
    pre-load callback:
      TestCase = 7;

  case "New Test Case 8" [baseline]
    model FBFunctions, harness FBFunctions_Harness4 (for FBFunctions/SUB_DUPLEX)
    pre-load callback:
      TestCase = 8;

  case "New Test Case 9" [baseline]
    model FBFunctions, harness FBFunctions_Harness4 (for FBFunctions/SUB_DUPLEX)
    pre-load callback:
      TestCase = 9;

  case "New Test Case 10" [baseline]
    model FBFunctions, harness FBFunctions_Harness4 (for FBFunctions/SUB_DUPLEX)
    pre-load callback:
      TestCase = 10;