test file "BNOR"
  coverage: Decision, MCDC, Condition

suite "New Test Suite 1"

  case "New Test Case 1" [baseline]
    model FBFunctions, harness FBFunctions_Harness_BNOR (for FBFunctions/BNOR_DUPLEX)
    parameter set "Parameter Set 1" (off): TestInps = 1  % base workspace
    parameter set "Parameter Set 2" (off): TestInps = 2  % base workspace
    parameter set "Parameter Set 3" (off): TestInps = 3  % base workspace
    parameter set "Parameter Set 4" (off): TestInps = 4  % base workspace
    parameter set "Parameter Set 5" (off): TestInps = 5  % base workspace
    parameter set "Parameter Set 6" (off):
      TestInps = 6 (off)  % base workspace
    parameter set "Parameter Set 7" (off):
      TestInps = 7 (off)  % base workspace
    parameter set "Parameter Set 8": TestInps = 8  % base workspace
    pre-load callback:
      TestCase = 1;
    iterations:
      Iteration1: ParameterSet "Parameter Set 1"
      Iteration2: ParameterSet "Parameter Set 2"
      Iteration3: ParameterSet "Parameter Set 3"
      Iteration4: ParameterSet "Parameter Set 4"
      Iteration5: ParameterSet "Parameter Set 5"
      Iteration6: ParameterSet "Parameter Set 1"
      Iteration7: ParameterSet "Parameter Set 2"
      Iteration8: ParameterSet "Parameter Set 3"

  case "New Test Case 2" [baseline]
    model FBFunctions, harness FBFunctions_Harness_BNOR (for FBFunctions/BNOR_DUPLEX)
    pre-load callback:
      TestCase = 2;

  case "New Test Case 3" [baseline]
    model FBFunctions, harness FBFunctions_Harness_BNOR (for FBFunctions/BNOR_DUPLEX)
    pre-load callback:
      TestCase = 3;