test file "BNOT"
  coverage: Decision, MCDC, Condition

suite "New Test Suite 1"

  case "New Test Case 1" [baseline]
    model FBFunctions, harness FBFunctions_Harness_BNOT (for FBFunctions/BNOT_DUPLEX)
    parameter set "Parameter Set 1" (off): TestInps = 1  % base workspace
    parameter set "Parameter Set 2" (off): TestInps = 2  % base workspace
    parameter set "Parameter Set 3" (off): TestInps = 3  % base workspace
    parameter set "Parameter Set 4" (off): TestInps = 4  % base workspace
    parameter set "Parameter Set 5" (off): TestInps = 5  % base workspace
    parameter set "Parameter Set 6": TestInps = 6  % base workspace
    pre-load callback:
      TestCase = 1;
    iterations:
      Iteration1: ParameterSet "Parameter Set 1"
      Iteration2: ParameterSet "Parameter Set 2"
      Iteration3: ParameterSet "Parameter Set 3"
      Iteration4: ParameterSet "Parameter Set 4"
      Iteration5: ParameterSet "Parameter Set 5"
      Iteration6: ParameterSet "Parameter Set 6"

  case "New Test Case 2" [baseline]
    model FBFunctions, harness FBFunctions_Harness_BNOT (for FBFunctions/BNOT_DUPLEX)
    pre-load callback:
      TestCase = 2;

  case "New Test Case 3" [baseline]
    model FBFunctions, harness FBFunctions_Harness_BNOT (for FBFunctions/BNOT_DUPLEX)
    pre-load callback:
      TestCase = 3;