# Requirement set FBFunctions_req (R2018b)

## 1 [#1] FB Services
The FB shall provide services to the FB Controller to facilitiate execution of the respective function block logic.

### 1.1 [#10] Logic Selection
The FBFunctions shall select the proper FB logic block as indicated by the fb_select signal.

### 1.2 [#3] FB Read/Write Information
The function block shall provide the number of expected input and output values to be read and written respectively for proper execution.

### 1.3 [#5] FB Duplex Redundancy
Each execution logic shall be a duplex system.

#### 1.3.1 [#7] Duplex State Comparison
Each state comparator shall indicate an error if the FB duplex execution systems do not provide identical output.

#### 1.3.2 [#17] Duplex Execution Completion
Each Duplex Logic block shall assert the execComplete signal once both internal simplex logic blocks have asserted the execComplete signal

### 1.4 [#18] Data Reading
The Logic block shall be enabled to read the input data into the shift register upon assertion of the enableIn signal.

#### 1.4.1 [#19] Data Read Execution
The shift register of each logic block shall save a single value from the dataIn signal upon each low->high transition of the enable signal.

### 1.5 [#6] Logic Execution Results
The FB shall execute the respective logic if no errors are read prior to the execution of that logic.

#### 1.5.1 [#22] NOR Logic
The NOR logical implementation shall take two bool or safebool values and provide the logical bool or safebool (respective) NOR operation

#### 1.5.2 [#23] AND Logic
The AND logical implementation shall take two bool or safebool values and provide the logical bool or safebool (respective) AND operation

#### 1.5.3 [#24] NOT Logic
The NOT logical implementation shall take one bool or safebool value and provide the logical bool or safebool (respective) NOT operation

#### 1.5.4 [#26] OR Logic
The OR logical implementation shall take two bool or safebool values and provide the logical bool or safebool (respective) OR operation

#### 1.5.5 [#27] XOR Logic
The XOR logical implementation shall take two bool or safebool values and provide the logical bool or safebool (respective) XOR operation

#### 1.5.6 [#28] NAND Logic
The NAND logical implementation shall take two bool or safebool values and provide the logical bool or safebool (respective) NAND operation

#### 1.5.7 [#29] BNOR Logic
The BNOR logical implementation shall take two bool, safebool, or integer values and provide the logical bool, safebool, or integer (respective) Bitwise NOR operation

#### 1.5.8 [#30] BAND Logic
The BAND logical implementation shall take two bool, safebool, or integer values and provide the logical bool, safebool, or integer (respective) Bitwise AND operation

#### 1.5.9 [#31] BNOT Logic
The BNOT logical implementation shall take one bool, safebool, or integer value and provide the logical bool, safebool, or integer (respective) Bitwise NOT operation

#### 1.5.10 [#32] BOR Logic
The BOR logical implementation shall take two bool, safebool, or integer values and provide the logical bool, safebool, or integer (respective) Bitwise OR operation

#### 1.5.11 [#33] BXOR Logic
The BXOR logical implementation shall take two bool, safebool, or integer values and provide the logical bool, safebool, or integer (respective) Bitwise XOR operation

#### 1.5.12 [#34] BNAND Logic
The BNAND logical implementation shall take two bool, safebool, or integer values and provide the logical bool, safebool, or integer (respective) Bitwise NAND operation

#### 1.5.13 [#35] BSL Logic
The BSL logical implementation shall take one integer value and provide the resultant integer Bitwise left shift operation for a single shift

#### 1.5.14 [#36] BSR Logic
The BSR logical implementation shall take one integer value and provide the resultant integer Bitwise right shift operation for a single shift

#### 1.5.15 [#37] GT Logic
The GT logical implementation shall take two integer or Qmn values and output a true signal if the first is "greater than" the second

#### 1.5.16 [#38] GE Logic
The GE logical implementation shall take two integer or Qmn values and output a true signal if the first is "greater than or equal to" the second

#### 1.5.17 [#39] EQ Logic
The EQ logical implementation shall take two integer or Qmn values and output a true signal if the first is "equal to" the second

#### 1.5.18 [#40] LT Logic
The LT logical implementation shall take two integer or Qmn values and output a true signal if the first is "less than" the second

#### 1.5.19 [#41] LE Logic
The LE logical implementation shall take two integer or Qmn values and output a true signal if the first is "less than or equal to" the second

#### 1.5.20 [#42] NE Logic
The NE logical implementation shall take two integer or Qmn values and output a true signal if the first is "not equal to" the second

#### 1.5.21 [#43] MAX Logic
The MAX logical implementation shall take two integer or Qmn values and output the greater of the two values

#### 1.5.22 [#44] MIN Logic
The MIN logical implementation shall take two integer or Qmn values and output the lesser

#### 1.5.23 [#45] MUX Logic
The MUX logical implementation shall take one boolean and two integer or Qmn values (do not need to match). The first integer is the MUX indicator, and the second and third values are operands. If the indicator has a value of '0', the first operand shall be written as output. If the indicator has a value of '1', the second operand shall be written as output.

#### 1.5.24 [#46] ADD Logic
The ADD logical implementation shall take two integer or Qmn values and output a resultant integer or Qmn (respective) value equal to the "sum" of the two input values.

#### 1.5.25 [#47] SUB Logic
The SUB logical implementation shall take two integer or Qmn values and output a resultant integer or Qmn (respective) value equal to the "difference" between the first and the second value as "output = first - second".

#### 1.5.26 [#48] MUL Logic
The MUL logical implementation shall take two integer or Qmn values and output a resultant integer or Qmn (respective) value equal to the "product" of the two input values.

#### 1.5.27 [#49] DIV Logic
The DIV logical implementation shall take two integer or Qmn values and output a resultant integer or Qmn (respective) value equal to the "division" between the first and the second value as "output = first / second".

#### 1.5.28 [#50] MOV Logic

#### 1.5.29 [#58] INTtoQMN Logic
The INTtoQMN logical implementation shall take one int value and output a Qmn value equal to the exact value of int.

#### 1.5.30 [#59] QMNtoINT Logic
The QMNtoINT logical implementation shall take one Qmn value and output an int value equal to the rounded integer value of the Qmn. Values <0.5 ar rounded down and >=0.5 are rounded up to the nearest integer

#### 1.5.31 [#60] BOOLtoSAFEBOOL
The BOOLtoSAFEBOOL logical implementation shall take one bool value and output a safebool value equal to the true/false value of the bool.

#### 1.5.32 [#61] SAFEBOOLtoBOOL
The SAFEBOOLtoBOOL logical implementation shall take one safebool value and output a bool value equal to the true/false value of the safebool.

### 1.6 [#51] Data Writing
The logic block shall be enabled to write the output data to the output register upon assertion of the enableResult signal and under the condition of no detected of the errors: data type error, overflow error, underflow error, divide_by_zero error

#### 1.6.1 [#52] Data Write Execution
The output shift register of each logic block shall write a single value fro m the dataIn signal upon each low->high transition of the enable signal.

### 1.7 [#15] FB Output
The FB shall output only the logic selected by the fb_select signal.

## 2 [#4] FB Errors
The FB shall indicate if any errors occur during the execution of the FB logic.

### 2.1 [#16] Duplex Errors
The FB shall report all errors from both duplex blocks

### 2.2 [#21] Input Data Validation
The logic block shall output an error if input data values are not as expected

#### 2.2.1 [#53] Data Type Mismatch
Each respective logic block shall output an error if input data types do not match

#### 2.2.2 [#54] Invalid Data Type
Each logic block shall output an error if an invalid data type is read

### 2.3 [#12] Logical Errors
The FB shall report any of the specified logical errors the occur during the execution of FB logic.

#### 2.3.1 [#55] Overflow
Each logical implementation shall report an error if overflow is detected

#### 2.3.2 [#56] Underflow
Each logical implementation shall report an error if underflow is detected

#### 2.3.3 [#57] Divide By Zero
Each logical implementation shall report an error if division by zero is attempted