test file "XOR"
  coverage: Decision, MCDC, Condition

suite "New Test Suite 1"

  case "New Test Case 1" [baseline]
    model FBFunctions, harness FBFunctions_Harness_XOR (for FBFunctions/XOR_DUPLEX)
    parameter set "Parameter Set 1": TestInps = 1
    parameter set "Parameter Set 2" (off): TestInps = 2
    parameter set "Parameter Set 3" (off): TestInps = 3
    parameter set "Parameter Set 4" (off): TestInps = 4
    parameter set "Parameter Set 5" (off): TestInps = 5
    parameter set "Parameter Set 6" (off): TestInps = 6
    parameter set "Parameter Set 7" (off): TestInps = 7
    parameter set "Parameter Set 8" (off): TestInps = 8
    parameter set "Parameter Set 9" (off): TestInps = 9
    parameter set "Parameter Set 10" (off): TestInps = 10
    parameter set "Parameter Set 11" (off): TestInps = 11
    parameter set "Parameter Set 12" (off): TestInps = 12
    parameter set "Parameter Set 13" (off): TestInps = 13
    parameter set "Parameter Set 14" (off): TestInps = 14
    parameter set "Parameter Set 15" (off): TestInps = 15
    pre-load callback:
      TestCase = 1;
    iterations:
      Iteration1: ParameterSet "Parameter Set 1"
      Iteration2: ParameterSet "Parameter Set 2"
      Iteration3: ParameterSet "Parameter Set 3"
      Iteration4: ParameterSet "Parameter Set 4"
      Iteration5: ParameterSet "Parameter Set 5"
      Iteration6: ParameterSet "Parameter Set 6"
      Iteration7: ParameterSet "Parameter Set 7"
      Iteration8: ParameterSet "Parameter Set 8"
      Iteration9: ParameterSet "Parameter Set 9"
      Iteration10: ParameterSet "Parameter Set 10"
      Iteration11: ParameterSet "Parameter Set 11"
      Iteration12: ParameterSet "Parameter Set 12"
      Iteration13: ParameterSet "Parameter Set 13"
      Iteration14: ParameterSet "Parameter Set 14"
      Iteration15: ParameterSet "Parameter Set 15"
      Iteration16 (disabled): ParameterSet "Parameter Set 16"

  case "New Test Case 2" [baseline]
    model FBFunctions, harness FBFunctions_Harness_XOR (for FBFunctions/XOR_DUPLEX)
    pre-load callback:
      TestCase = 2;

  case "New Test Case 3" [baseline]
    model FBFunctions, harness FBFunctions_Harness_XOR (for FBFunctions/XOR_DUPLEX)
    pre-load callback:
      TestCase = 3;