# Requirement set FBController_req (R2018b)

## 1 [#6] FBController
The FB Controller shall provide the USER the ability to execute FB+FBD

## 2 [#7] FBController Services
The FB controller shall provide services to FBs to permit correct + deterministic execution of FBs

### 2.1 [#17] FB Controller Synchronous Execution
The FB Controller shalll assist in the Fault detection, reporting, and diagnosis of FB execution

### 2.2 [#18] FB Controller Set/Reset
The FB Controller shall have the ability to set/reset state of FBs and FBDs

### 2.3 [#19] FB Controller Fault Detection
The FB Controller shall assist in the Fault detection, reporting, and diagnosis of FB execution

## 3 [#8] FB Controller Watchdog
Shall provide the ability to Reset untimely executions, mitigation actions in a task FBD

## 4 [#9] FB StateFlow Controller
The FB state flow controller shall be a Moore state machine which Receives signals indicating the current state of the function block, and manages the state transitions in order to 1) control the function block’s correct execution and 2) catch and report any errors that arise during execution.

## 5 [#10] Input Counter
The input counter shall record the number of input values read, indicating an error if the expected number is exceeded.

## 6 [#22] Output Counter
The output counter shall record the number of input values written, indicating an error if the expected number is exceeded.

## 7 [#23] Counter Selector
The counter selector shall select the input or output counter when the input STATE is in the READ or WRITE state and outputting 0 else.

## 8 [#24] Error Code Generation
The error code generator shall generate an error code and a binary error indicator from the individual error codes passed to the function.