test file "Fb_Controller"
  coverage: Decision, MCDC, Condition

suite "New Test Suite 1"

  case "Init State" [baseline]
    description: Verify that in Init state all the done,busy,state, error of status output and enableIn,enableOut,enableResult and reset of fb_control and all reset to 0 in the FbController
    model FB_Controller, harness FB_Controller_Harness_FbController, stop time 10
    pre-load callback:
      TestCase = 1;

  case "Idle State" [simulation]
    model FB_Controller, harness FB_Controller_Harness_FbController, stop time 10
    pre-load callback:
      TestCase = 2;

  case "Read Input" [baseline]
    model FB_Controller, harness FB_Controller_Harness_FbController
    pre-load callback:
      TestCase = 3

  case "Execute" [baseline]
    model FB_Controller, harness FB_Controller_Harness_FbController
    pre-load callback:
      TestCase = 4

  case "ERROR in execute" [baseline]
    model FB_Controller, harness FB_Controller_Harness_FbController
    pre-load callback:
      TestCase = 5

  case "write output 1st state" [baseline]
    model FB_Controller, harness FB_Controller_Harness_FbController
    pre-load callback:
      TestCase = 6

  case "write output 2nd state" [baseline]
    model FB_Controller, harness FB_Controller_Harness_FbController
    pre-load callback:
      TestCase = 7

  case "DONE" [baseline]
    model FB_Controller, harness FB_Controller_Harness_FbController
    pre-load callback:
      TestCase = 8

  case "ERROR in WRITE OUTPUT 2nd state state and Output Overflow" [baseline]
    description: Verify that the state changes to FB_DONE if the super state (upper 4 bits of Code in status signal) has changed indicating next state.
      Verify that a ctrl pulse is sent to function blocks to progress its state.
      Verify that an Error while in FB_Done state does not cause it the local sequencer to move to the ERROR state.
    model FB_Controller, harness FB_Controller_Harness_FbController
    pre-load callback:
      TestCase = 9

  case "ERROR in WRITE OUTPUT 1st state" [baseline]
    model FB_Controller, harness FB_Controller_Harness_FbController
    pre-load callback:
      TestCase = 10

  case "ERROR in READ INPUT" [baseline]
    model FB_Controller, harness FB_Controller_Harness_FbController
    pre-load callback:
      TestCase = 11

  case "Input Overflow" [baseline]
    model FB_Controller, harness FB_Controller_Harness_FbController
    pre-load callback:
      TestCase = 12

  case "TimeOut" [baseline]
    description: Verify that the state switches to Fetch automatically.
      Verify that the fetch address in the instruction sequence is latched on the addr output.
      Verify that there is one cycle of wait state for data to be available to function blocks from task memories.
      Verify that in the next cycle a ctrl pulse is sent to function blocks to begin execution.
      Verify that after 2 cycles the instruction pointer is incremented.
    model FB_Controller, harness FB_Controller_Harness_FbController
    pre-load callback:
      TestCase = 13