test file "Local_Sequencer"
  coverage: Decision, MCDC, SignalRange, SimulinkDesignVerifier, RelationalBoundary, Condition, LookupTable, SignalSize, SaturationOnIntOverflow

suite "New Test Suite 1"

  case "Init State" [baseline]
    description: Verify that in Init state all the outputs task_done, inst_ptr, task_error, latch_addr, write, ctrl, abort and fb_select of local sequencer are reset to 0.
      The instruction pointer should be reset to 0 to point to the first instruction.
    model local_sequencer, harness local_sequencer_Harness3, stop time 10
    pre-load callback:
      TestCase = 1;

  case "FB_Select State" [simulation]
    description: Verify that with a trigger from global sequencer, the task execution is initiated.
      Verify that the state transitions from INIT to FB_SELECT.
      Verify that the function number register and start instruction pointer register are latched to the first instruction in the sequence
      Verify that in the next cycle the instruction pointer increments..
    model local_sequencer, harness local_sequencer_Harness3, stop time 10
    pre-load callback:
      TestCase = 2;

  case "Fetch State 1st Input and verify Addr output" [baseline]
    description: Verify that the state switches to Fetch automatically.
      Verify that there is one cycle of wait state for data to be available to function blocks from task memories.
      Verify that in the next cycle a ctrl pulse is sent to function blocks to begin execution.
      Verify that after 2 cycles the instruction pointer is incremented.
    model local_sequencer, harness local_sequencer_Harness3, stop time 20
    pre-load callback:
      TestCase = 3

  case "Fetch State 2nd Input" [baseline]
    description: Verify that the state remains in Fetch if the super state (upper 4 bits of Code in status signal) has not changed but the code data bits 22 through 27 has been incremented once indicating a super state iteration.
      Verify that the 2nd input fetch address in the instruction sequence is latched on to the addr output.
      Verify that there is one cycle of wait state for data to be available to function blocks from task memories.
      Verify that a ctrl pulse is sent to function blocks to begin execution.
      Verify that the instruction pointer is incremented.
    model local_sequencer, harness local_sequencer_Harness3, stop time 27
    pre-load callback:
      TestCase = 4

  case "Fetch State 3rd Input" [baseline]
    description: Verify that the state remains in Fetch if the super state (upper 4 bits of Code in status signal) has not changed but the code data bits 22 through 27 has been incremented once indicating a super state iteration.
      Verify that the 3rd input fetch address in the instruction sequence is latched on to the addr output.
      Verify that there is one cycle of wait state for data to be available to function blocks from task memories.
      Verify that a ctrl pulse is sent to function blocks to begin execution.
      Verify that the instruction pointer is incremented.
      Verify that the state stays in Fetch until the super state change from global sequencer is detected.
    model local_sequencer, harness local_sequencer_Harness3, stop time 35
    pre-load callback:
      TestCase = 5

  case "Execute State" [baseline]
    description: Verify that the state changes to Execute if the super state (upper 4 bits of Code in status signal) has changed indicating next state.
      Verify that a ctrl pulse is sent to the function blocks for execution.
    model local_sequencer, harness local_sequencer_Harness3, stop time 40
    pre-load callback:
      TestCase = 6

  case "Write State 1st output" [baseline]
    description: Verify that the state changes to Write if the super state (upper 4 bits of Code in status signal) has changed indicating next state.
      Verify that the output address in the instruction sequence is latched on to the addr output.
      Verify that a ctrl pulse is sent to function blocks to begin execution.
      Verify that the write output is set high to allow the function block to write the result to the current address.
      Verify that the instruction pointer is incremented after one cycle.
    model local_sequencer, harness local_sequencer_Harness3, stop time 45
    pre-load callback:
      TestCase = 7

  case "Write State 2nd Output" [baseline]
    description: Verify that the state remains in Write if the super state (upper 4 bits of Code in status signal) has not changed but the code data bits 22 through 27 has been incremented once indicating a super state iteration.
      Verify that the 2nd output address in the instruction sequence is latched on to the addr output.
      Verify that a ctrl pulse is sent to function blocks to begin execution.
      Verify that the write output is set high to allow the function block to write the result to the current address.
      Verify that the instruction pointer is incremented.
    model local_sequencer, harness local_sequencer_Harness3, stop time 50
    pre-load callback:
      TestCase = 8

  case "FB Done state" [baseline]
    description: Verify that the state changes to FB_DONE if the super state (upper 4 bits of Code in status signal) has changed indicating next state.
      Verify that a ctrl pulse is sent to function blocks to progress its state.
      Verify that an Error while in FB_Done state does not cause it the local sequencer to move to the ERROR state.
    model local_sequencer, harness local_sequencer_Harness3, stop time 60
    pre-load callback:
      TestCase = 9

  case "Error in FB Select State" [baseline]
    description: Verify that the state changes to FB_SELECT if the super state (upper 4 bits of Code in status signal) has changed indicating next state.
      Verify that the function number register and start instruction pointer register are latched to the 2nd function block instruction in the sequence.
      Verify that the instruction pointer is incremented.
      Verify that an Error while in FB_SELECT state does not cause it the local sequencer to move to the ERROR state.
    model local_sequencer, harness local_sequencer_Harness3, stop time 60
    pre-load callback:
      TestCase = 10

  case "Error in Fetch State" [baseline]
    description: Verify that the state switches to Fetch automatically.
      Verify that the fetch address in the instruction sequence is latched on the addr output.
      Verify that the state switches to ERROR if the Error signal in Status input is true.
      Verify that a ctrl pulse is sent to function blocks.
      Verify that abort and Task_Error output signals are set to false if the lower 22 bits of the Code in Status signal indicate a recoverable error.
    model local_sequencer, harness local_sequencer_Harness3, stop time 65
    pre-load callback:
      TestCase = 11

  case "Recoverable Error" [baseline]
    description: If the lower 22 bits of the Code in Status signal indicate a recoverable error, verify that the state changes from ERROR to FB_SELECT.
      With a recoverable error verify that the instruction pointer is loaded with the value stored in the start instruction pointer register.
      Verify that the instruction pointer is incremented.
    model local_sequencer, harness local_sequencer_Harness3, stop time 70
    pre-load callback:
      TestCase = 12

  case "FB Select to FETCH State" [baseline]
    description: Verify that the state switches to Fetch automatically.
      Verify that the fetch address in the instruction sequence is latched on the addr output.
      Verify that there is one cycle of wait state for data to be available to function blocks from task memories.
      Verify that in the next cycle a ctrl pulse is sent to function blocks to begin execution.
      Verify that after 2 cycles the instruction pointer is incremented.
    model local_sequencer, harness local_sequencer_Harness3, stop time 70
    pre-load callback:
      TestCase = 13

  case "Non Recoverable Error" [baseline]
    description: Verify that the state changes to Execute if the super state (upper 4 bits of Error Code in status signal) has changed indicating next state.
      Verify that a ctrl pulse is sent to the function blocks for execution.
      Verify that the state switches to ERROR if the Error signal in Status input is true.
      If the lower 22 bits of the Code in Status signal indicate a non recoverable error, verify that a ctrl and abort signals are pulsed for one cycle.
      Verify that the Task_Error output is set to true until the Trigger goes low.
    model local_sequencer, harness local_sequencer_Harness3, stop time 70
    pre-load callback:
      TestCase = 14

  case "Non Recoverable Error to INIT" [baseline]
    description: Verify that the state transitions from ERROR state to INIT if the error is not recoverable and the trigger from the global sequencer is low.
      Verify if in Init state all the outputs are reset to 0.
      The instruction pointer should be reset to 0 to point to the first instruction in the sequence
    model local_sequencer, harness local_sequencer_Harness3, stop time 70
    pre-load callback:
      TestCase = 15

  case "Error in Write State" [baseline]
    description: Verify that with a trigger from global sequencer, the task execution is initiated.
      The state transitions from INIT to FB_SELECT.
      Verify that the function number register and start instruction pointer register are latched to the first instruction in the sequence.
      Verify that the instruction pointer increments.
      Verify that the write state is entered.
      Verify that Error state is entered from write state if error is detected.
    model local_sequencer, harness local_sequencer_Harness3, stop time 100
    pre-load callback:
      TestCase = 16

  case "End of Sequence" [baseline]
    description: Verify that state moves to Task_Done from FB_Done state once function block signals a new state and EOF flag is the current instruction.
      Verify that Task_Done output is set to TRUE while in the Task_Done state.
    model local_sequencer, harness local_sequencer_Harness3
    pre-load callback:
      TestCase = 17

  case "Task Done to INIT" [baseline]
    description: Verify that the state moves from Task_Done to INIT state once Trigger goes low.
    model local_sequencer, harness local_sequencer_Harness3, stop time 130
    pre-load callback:
      TestCase = 18

  case "Error in LATCH_ADDR substate in Fetch State" [simulation]
    description: Verify that Error state is entered from the LATCH_ADDR substate of Fetch state if Error is detected.
    model local_sequencer, harness local_sequencer_Harness3, stop time 130
    pre-load callback:
      TestCase = 19

  case "Error in MEM_WAIT substate in Fetch State" [simulation]
    description: Verify that Error state is entered from the MEM_WAIT substate of Fetch state if Error is detected.
    model local_sequencer, harness local_sequencer_Harness3, stop time 150
    pre-load callback:
      TestCase = 20

  case "Error in CTRL_HI SubState in Fetch State" [simulation]
    description: Verify that Error state is entered from the CTRL_HI substate of Fetch state if Error is detected.
    model local_sequencer, harness local_sequencer_Harness3, stop time 140
    pre-load callback:
      TestCase = 21

  case "Error in CTRL_LO substate in Fetch State" [simulation]
    description: Verify that Error state is entered from the CTRL_LO substate of Fetch state if Error is detected.
    model local_sequencer, harness local_sequencer_Harness3, stop time 140
    pre-load callback:
      TestCase = 22

  case "Error in INCREMENT_INST Substate in Fetch state" [simulation]
    description: Verify that Error state is entered from the INCREMENT_INST subtate of Fetch state if Error is detected.
    model local_sequencer, harness local_sequencer_Harness3, stop time 140
    pre-load callback:
      TestCase = 23

  case "Error in INST_WAIT Substate in Fetch state" [simulation]
    description: Verify that Error state is entered from the INST_WAIT substate of Fetch state if Error is detected.
    model local_sequencer, harness local_sequencer_Harness3, stop time 140
    pre-load callback:
      TestCase = 24

  case "Error in CTRL_HI Substate in FB_EXECUTE state" [simulation]
    description: Verify that Error state is entered from the CTRL_HI substate of FB_EXECUTE state if Error is detected.
    model local_sequencer, harness local_sequencer_Harness3, stop time 140
    pre-load callback:
      TestCase = 25

  case "Error in CTRL_LO Substate in FB_EXECUTE state" [simulation]
    description: Verify that Error state is entered from the CTRL_LO substate of FB_EXECUTE state if Error is detected.
    model local_sequencer, harness local_sequencer_Harness3, stop time 140
    pre-load callback:
      TestCase = 26

  case "Error in LATCH_ADDR Substate in Write state" [simulation]
    description: Verify that Error state is entered from the LATCH_ADDR substate of Write state if Error is detected.
    model local_sequencer, harness local_sequencer_Harness3, stop time 140
    pre-load callback:
      TestCase = 27

  case "Error in CTRL_HI Substate in Write state" [simulation]
    description: Verify that Error state is entered from the CTRL_HI substate of Write state if Error is detected.
    model local_sequencer, harness local_sequencer_Harness3, stop time 140
    pre-load callback:
      TestCase = 28

  case "Error in CTRL_LO Substate in Write state" [simulation]
    description: Verify that Error state is entered from the CTRL_LO substate of Write state if Error is detected.
    model local_sequencer, harness local_sequencer_Harness3, stop time 140
    pre-load callback:
      TestCase = 29

  case "Error in WRITE Substate in Write state" [simulation]
    description: Verify that Error state is entered from the WRITE substate of Write state if Error is detected.
    model local_sequencer, harness local_sequencer_Harness3, stop time 140
    pre-load callback:
      TestCase = 30

  case "Error in INCREMENT_INST Substate in Write state" [simulation]
    description: Verify that Error state is entered from the INCREMENT_INST substate of Write state if Error is detected.
    model local_sequencer, harness local_sequencer_Harness3, stop time 140
    pre-load callback:
      TestCase = 31

  case "Error in INST_WAIT Substate in Write state" [simulation]
    description: Verify that Error state is entered from the INST_WAIT substate of Write state if Error is detected.
    model local_sequencer, harness local_sequencer_Harness3, stop time 140
    pre-load callback:
      TestCase = 32

suite "New Test Suite 2"

  case "New Test Case 1" [baseline]
    model local_sequencer, harness local_sequencer_Harness4
    signal scenario: Test Case 1 (local_sequencer_Harness4/Harness Inputs)
    baseline "TestCase_1.mat"
      task_error:1
      task_done:1
      inst_ptr:1
      addr:1
      write:1
      ctrl:1
      abort:1
      fb_select:1
      StateFlowMode:1
      latch_addr:1
      increment:1
      latch_function:1
      latch_inst_start:1
      state_iteration:1
      new_state:1
      error:1
    baseline "TestCase_2.mat"
      task_error:1
      task_done:1
      inst_ptr:1
      addr:1
      write:1
      ctrl:1
      abort:1
      fb_select:1
      StateFlowMode:1
      latch_addr:1
      increment:1
      latch_function:1
      latch_inst_start:1
      state_iteration:1
      new_state:1
      error:1
    baseline "TestCase_3.mat"
      task_error:1
      task_done:1
      inst_ptr:1
      addr:1
      write:1
      ctrl:1
      abort:1
      fb_select:1
      StateFlowMode:1
      latch_addr:1
      increment:1
      latch_function:1
      latch_inst_start:1
      state_iteration:1
      new_state:1
      error:1
    baseline "TestCase_4.mat"
      task_error:1
      task_done:1
      inst_ptr:1
      addr:1
      write:1
      ctrl:1
      abort:1
      fb_select:1
      StateFlowMode:1
      latch_addr:1
      increment:1
      latch_function:1
      latch_inst_start:1
      state_iteration:1
      new_state:1
      error:1
    baseline "TestCase_5.mat"
      task_error:1
      task_done:1
      inst_ptr:1
      addr:1
      write:1
      ctrl:1
      abort:1
      fb_select:1
      StateFlowMode:1
      latch_addr:1
      increment:1
      latch_function:1
      latch_inst_start:1
      state_iteration:1
      new_state:1
      error:1
    baseline "TestCase_6.mat"
      task_error:1
      task_done:1
      inst_ptr:1
      addr:1
      write:1
      ctrl:1
      abort:1
      fb_select:1
      StateFlowMode:1
      latch_addr:1
      increment:1
      latch_function:1
      latch_inst_start:1
      state_iteration:1
      new_state:1
      error:1
    baseline "TestCase_7.mat"
      task_error:1
      task_done:1
      inst_ptr:1
      addr:1
      write:1
      ctrl:1
      abort:1
      fb_select:1
      StateFlowMode:1
      latch_addr:1
      increment:1
      latch_function:1
      latch_inst_start:1
      state_iteration:1
      new_state:1
      error:1
    baseline "TestCase_8.mat"
      task_error:1
      task_done:1
      inst_ptr:1
      addr:1
      write:1
      ctrl:1
      abort:1
      fb_select:1
      StateFlowMode:1
      latch_addr:1
      increment:1
      latch_function:1
      latch_inst_start:1
      state_iteration:1
      new_state:1
      error:1
    baseline "TestCase_9.mat"
      task_error:1
      task_done:1
      inst_ptr:1
      addr:1
      write:1
      ctrl:1
      abort:1
      fb_select:1
      StateFlowMode:1
      latch_addr:1
      increment:1
      latch_function:1
      latch_inst_start:1
      state_iteration:1
      new_state:1
      error:1
    baseline "TestCase_10.mat" (0 of 16 signals compared)
    baseline "TestCase_11.mat"
      task_error:1
      task_done:1
      inst_ptr:1
      addr:1
      write:1
      ctrl:1
      abort:1
      fb_select:1
      StateFlowMode:1
      latch_addr:1
      increment:1
      latch_function:1
      latch_inst_start:1
      state_iteration:1
      new_state:1
      error:1
    iterations:
      Test Case 1: SignalBuilderGroup "Test Case 1", Baseline "TestCase_1.mat"
      Test Case 2: SignalBuilderGroup "Test Case 2", Baseline "TestCase_2.mat"
      Test Case 3: SignalBuilderGroup "Test Case 3", Baseline "TestCase_3.mat"
      Test Case 4: SignalBuilderGroup "Test Case 4", Baseline "TestCase_4.mat"
      Test Case 5: SignalBuilderGroup "Test Case 5", Baseline "TestCase_5.mat"
      Test Case 6: SignalBuilderGroup "Test Case 6", Baseline "TestCase_6.mat"
      Test Case 7: SignalBuilderGroup "Test Case 7", Baseline "TestCase_7.mat"
      Test Case 8: SignalBuilderGroup "Test Case 8", Baseline "TestCase_8.mat"
      Test Case 9: SignalBuilderGroup "Test Case 9", Baseline "TestCase_9.mat"
      Test Case 10: SignalBuilderGroup "Test Case 10", Baseline "TestCase_10.mat"
      Test Case 11: SignalBuilderGroup "Test Case 11", Baseline "TestCase_11.mat"