# Requirement set local_sequencer_req (R2018b)
The local sequencer shall provide control and coordination between task function blocks and task memories in order to execute function blocks sequentially while providing inputs to the function blocks from task memories and to store outputs from the function blocks to the task memories.

## 1 [#1] Trigger Service Received
Shall receive a level sensitive trigger from the global sequencer that initiates task execution.

## 2 [#2] Instruction Service Received
The local sequencer shall receive a list of instructions in a sequential fashion that includes each function block to be exeucted, the function block input and output task memory addresses.

### 2.1 [#7] End of File Determination
The local sequencer shall compare each instruction to see if the end of file flag has been reached.

## 3 [#3] Function Block Status Service Received
The local sequence shall receive a status signal from the task function blocks that includes a boolean status and error code word.

### 3.1 [#4] Super State Iteration Detection
Bits 22 through 27 of the error code shall be extracted, incremented, and compared to the same bits on subsequent execution cycles to see if the function blocks iterated in the same same super state.

### 3.2 [#5] Super State Change Detection
The upper four bits of the error code in the status signal shall be extrated and compared to pervious bits to see if a super state change has occured.

### 3.3 [#6] Error Recovery Determination
The lower 22 bits of the error code in the status signal shall be extracted and compared to a list of recoverable functions to see if the architecture supports resiliency from the error code experienced.

## 4 [#8] Function Number Register
At the begining of an instruction sequence (variable length) the first instruction (the function number) shall be latched in an isolated register from the instruction service.

## 5 [#9] Start Instruction Pointer Register
The begining position of a sequence of instructions shall be latched into an isolated register.
Rationale: Latching of the first instruction in a sequence of instrucitons is necessary so that the instruction pointer counter can be loaded with this value if a fault is experienced and the instruction sequence must be restarted.

## 6 [#10] Instruction Counter
A counter will serve as the pointer for the instruction pointer. The counter will be capable of loading a stored begining instruction position so that a sequence can be restarted at the begining of the sequence when a fault is detected.

## 7 [#11] Current Address Register
The current address in task memory of an input or output to a function block shall have a dedicated register. Addresses shall be latched from an instruction sequence.

## 8 [#12] Controller Super States

### 8.1 [#13] INIT
All controller outputs shall be initialized to false except reset, which is initialized to true.

#### 8.1.1 [#21] Transistions
1) When trigger is true, the controller shall transition to the FB_SELECT super state.

### 8.2 [#14] FB_SELECT
If the recoverable input to the controller is true the instruction counter will be loaded with the value stored in the Start Instruction register. Otherwise, the function number register and start instruction pointer register will be latched. After the above operations, the instruction counter will be incremented.

#### 8.2.1 [#22] Transitions
1) When state operations are complete, the controller will transition automatically to the fetch state.

### 8.3 [#15] FETCH
1) Latch current address
2) Wait for data to be available to function blocks from task memories.
3) Send ctrl pulse to function blocks to begin execution.
4) Increment the current instruction number.
5) Wait for the next instruction to become available.

#### 8.3.1 [#23] Transitions
1) To ERROR if any function block experiences an error or fault.
2) To FB_EXECUTE if the current function block indicates a state change.
3) To FETCH if a state iteration is signaled by the current function block.

### 8.4 [#16] FB_EXECUTE
In this state the local sequencer will send a ctrl pulse to the function blocks to progress in state.

#### 8.4.1 [#24] Transitions
1) To ERROR if a function block signals an error.
2) To WRITE when a function block signals a new state.

### 8.5 [#17] WRITE
1) Latch the address of the current output
2) Pulse the control signal to cause a state change in the current function block.
3) Write the result of the function block to the current address.
4) Increment the instruction pointer.
5) Wait for the next instruction to be available.

#### 8.5.1 [#25] Transitions
1) To ERROR if the current function block signals an error.
2) To FB_DONE is the current function block signals a new state.
3) To WRITE if the current function block signals a state iteration.

### 8.6 [#18] FB_DONE
In this state the local sequencer will progress the state of the current function block with a ctrl pulse.

#### 8.6.1 [#26] Transitions
1) To TASK_DONE when the function block signals a new state and the end of file flag is the current instruction.
2) To FB_SELECT otherwise when the function block signals a new state.

### 8.7 [#19] TASK_DONE
The local sequencer will wait in the TASK_DONE state and signal to the global sequencer that the task is done.

#### 8.7.1 [#27] Transitions
1) To INIT when the trigger from the global sequencer goes low.

### 8.8 [#20] ERROR
The local sequencer will set pulse control if the error is recoverable in this state. If the error is not recoverable, ctrl and abort will both be pulsed simultaneously and the local sequencer will signal a task error to the global sequencer.

#### 8.8.1 [#28] Transitions
1) To FB_SELECT if the error is recoverable.
2) To INIT if the error is not recoverable and the trigger from the global sequencer is low.

## 9 [#32] Instruction Pointer Service Provided
The local sequencer shall provide a pointer to the current instruction.

## 10 [#33] Function Block Selection Service Provided
The local sequencer shall provide a signal that indicates which function is active.

## 11 [#34] Conversion of Data Input
Inputs to the current address and function number register shall be converted to be compatible with the respective registers.

## 12 [#29] Error Signal Service Provided
The local sequencer shall signal to the global sequencer when an unrecoverable error is encountered in a task.

## 13 [#30] Task Done Service Provided
The local sequencer shall signal to the global sequencer when the task is complete.

## 14 [#31] Task Memory Control Service Provided
The local sequencer shall control the address and write enable inputs to the task memories.